# Grasshopper definition sine curve poles.gh (Grasshopper 1.0.7)
# plug-ins: Hops, Mesh Pipe

panel = Panel("/createRandomPoints")
panel_2 = Panel("/createGraph")

number_slider = Slider(30, range=0..100)  # disabled
number_slider_2 = Slider(1, range=1..50)  # disabled
period = Slider(6.001, range=1..10)  # disabled
shift = Slider(5, range=1..20)  # disabled
series = Series(Start=0, Step=1, Count=number_slider)  # disabled
amplitude = Slider(3.252, range=1..10)  # disabled
multiplication = Multiplication(A=series, B=period)  # disabled
addition = Addition(A=multiplication, B=shift)  # disabled
panel_3 = Panel(series)  # disabled
sin = Sine(Value=addition)  # disabled
multiplication_2 = Multiplication(A=sin, B=amplitude)  # disabled
pt = ConstructPoint(XCoordinate=series, YCoordinate=multiplication_2, ZCoordinate=0)  # disabled

data = Data("/neilbersabe_Hops")
concat = Concatenate(FragmentA="http://127.0.0.1:5000", FragmentB=data)
hops = Hops(
    _Path=concat,
    Step=Slider(0.495, range=0.1..3),
    Count=Slider(69, range=1..100),
    Offset=Slider(4, range=1..100),
    Period=Slider(1.903, range=0..10),
    Shift=Slider(4, range=0..100),
    Amplitude=Slider(3, range=0..100),
    CacheResultsInMemory=False,
    CacheSolveResults=False,
    RemoteDefinitionLocation="http://127.0.0.1:5000/neilbersabe_Hops",
    RemoteSolveVersion=(0, 1, 0),
    ShowInput_Enabled=False,
    ShowInput_Path=True,
    SynchronousSolve=True)  # -> BasePoints, MidPoints1, MidPoints2, TopPoints, PointsList
panel_4 = Panel(hops.BasePoints)
viewer = ParamViewer(hops.BasePoints)
ln = Line(StartPoint=hops.BasePoints, EndPoint=hops.MidPoints1)
ln_2 = Line(StartPoint=hops.MidPoints1, EndPoint=hops.MidPoints2)
ln_3 = Line(StartPoint=hops.MidPoints2, EndPoint=hops.TopPoints)
join = JoinCurves(Curves=[ln, ln_2, ln_3], Preserve=False)
panel_5 = Panel(join)
mpipe = MeshPipe(Curve=join, Radius=Slider(0.15, range=0..1), Accuracy=0.2, Rotation=0, Segments=10, Caps=2)
mcol = MeshColours(Mesh=mpipe, Colours=ColourSwatch(SwatchColor=RGB(255, 234, 0)))
